# Grasshopper definition slidingtube-3dprinting.gh (Grasshopper 1.0.8)

# ---- group: 01 | Dimensions in mm
number_slider = Slider(6, range=1..20)
number_slider_2 = Slider(2.5, range=0.2..10)
number_slider_3 = Slider(30, range=1..100)
number_slider_4 = Slider(6, range=0..30)
number_slider_5 = Slider(4, range=0..30)
number_slider_6 = Slider(6, range=3..30)
number_slider_7 = Slider(2, range=0.5..10)

# ---- group: 02 | Radii and bounds
division = Division(A=number_slider, B="2")
division_2 = Division(A=number_slider_2, B="2")
division_3 = Division(A=number_slider_6, B="2")
addition = Addition(A=division, B=number_slider_4)
neg = Negative(Value=division_3)
addition_2 = Addition(A=number_slider_3, B=number_slider_7)
neg_2 = Negative(Value=addition)
addition_3 = Addition(A=division, B=number_slider_5)

# ---- group: 03 | Tab on bed / stem above
pt = ConstructPoint(XCoordinate=0, YCoordinate=0, ZCoordinate=number_slider_7)
xy = XYPlane(Origin=pt)
cyl = Cylinder(Base=xy, Radius=division, Length=number_slider_3)
pt_2 = ConstructPoint(XCoordinate=neg_2, YCoordinate=neg, ZCoordinate=0)
pt_3 = ConstructPoint(XCoordinate=addition_3, YCoordinate=division_3, ZCoordinate=number_slider_7)
cap = CapHoles(Brep=cyl)
box = Box2Pt(PointA=pt_2, PointB=pt_3, Plane=PlaneXY(0, 0, 0))
sunion = SolidUnion(Breps=[cap, box])

# ---- group: 04 | Continuous bore / oversized cutter
addition_4 = Addition(A=addition_2, B=number_slider_7)
neg_3 = Negative(Value=number_slider_7)
addition_5 = Addition(A=addition_4, B=number_slider_7)
pt_4 = ConstructPoint(XCoordinate=0, YCoordinate=0, ZCoordinate=neg_3)
xy_2 = XYPlane(Origin=pt_4)
cyl_2 = Cylinder(Base=xy_2, Radius=division_2, Length=addition_5)
cap_2 = CapHoles(Brep=cyl_2)

# ---- group: 05 | Only final solid previews
sdiff = SolidDifference(BrepsA=sunion, BrepsB=cap_2)
brep = Brep(sdiff)
