# Grasshopper definition slidingtube-squared-3dprinting.gh (Grasshopper 1.0.8)

# ---- group: 01 | Dimensions in mm
number_slider = Slider(6, range=1..20)
number_slider_2 = Slider(2.5, range=0.2..10)
number_slider_3 = Slider(30, range=1..100)
number_slider_4 = Slider(6, range=0..30)
number_slider_5 = Slider(4, range=0..30)
number_slider_6 = Slider(6, range=3..30)
number_slider_7 = Slider(2, range=0.5..10)

# ---- group: 02 | Half-widths and bounds
division = Division(A=number_slider, B="2")
division_2 = Division(A=number_slider_2, B="2")
division_3 = Division(A=number_slider_6, B="2")
addition = Addition(A=division, B=number_slider_4)
neg = Negative(Value=division_3)
addition_2 = Addition(A=number_slider_3, B=number_slider_7)
neg_2 = Negative(Value=addition)
addition_3 = Addition(A=division, B=number_slider_5)

# ---- group: 03 | Tab on bed / stem above
neg_3 = Negative(Value=division)
pt = ConstructPoint(XCoordinate=neg_3, YCoordinate=neg_3, ZCoordinate=number_slider_7)
pt_2 = ConstructPoint(XCoordinate=neg_2, YCoordinate=neg, ZCoordinate=0)
pt_3 = ConstructPoint(XCoordinate=addition_3, YCoordinate=division_3, ZCoordinate=number_slider_7)
pt_4 = ConstructPoint(XCoordinate=division, YCoordinate=division, ZCoordinate=addition_2)
box = Box2Pt(PointA=pt_2, PointB=pt_3, Plane=PlaneXY(0, 0, 0))
box_2 = Box2Pt(PointA=pt, PointB=pt_4, Plane=PlaneXY(0, 0, 0))
sunion = SolidUnion(Breps=[box_2, box])

# ---- group: 04 | Continuous bore / oversized cutter
addition_4 = Addition(A=addition_2, B=number_slider_7)
neg_4 = Negative(Value=division_2)
neg_5 = Negative(Value=number_slider_7)
pt_5 = ConstructPoint(XCoordinate=neg_4, YCoordinate=neg_4, ZCoordinate=neg_5)
pt_6 = ConstructPoint(XCoordinate=division_2, YCoordinate=division_2, ZCoordinate=addition_4)
box_3 = Box2Pt(PointA=pt_5, PointB=pt_6, Plane=PlaneXY(0, 0, 0))

# ---- group: 05 | Only final solid previews
sdiff = SolidDifference(BrepsA=sunion, BrepsB=box_3)
brep = Brep(sdiff)
