# Grasshopper definition spool-3dprinting.gh (Grasshopper 1.0.8)

# ---- group: 02 — Shaft Interface
dom = ConstructDomain(DomainStart=-10, DomainEnd=10)
number_slider = Slider(0.2, range=0.05..0.5)
number_slider_2 = Slider(7, range=4..10)
addition = Addition(A=Slider(3, range=2.5..4), B=number_slider)
addition_2 = Addition(A=Slider(5, range=4.5..5.5), B=number_slider)
division = Division(A=addition, B=2)
division_2 = Division(A=addition_2, B=2)
neg = Negative(Value=division)
dom_2 = ConstructDomain(DomainStart=neg, DomainEnd=division)

# ---- group: 03 — Fishing Line Parameters
number_slider_3 = Slider(1, range=1..10)
number_slider_4 = Slider(0.24, range=0.1..1)
number_slider_5 = Slider(9.5, range=8..10.5)
number_slider_6 = Slider(0, range=0..360)
number_slider_7 = Slider(3.5, range=0.5..6)
division_3 = Division(A=Slider(2, range=0.5..2), B=2)

# ---- group: 05 — Shaft Cutout
Z = UnitZ(Factor=number_slider_2)
cir = Circle(Plane=PlaneXY(0, 0, 0), Radius=division_2)
rectangle = Rectangle(Plane=PlaneXY(0, 0, 0), XSize=dom_2, YSize=dom, Radius=0)  # -> Rectangle, Length
rint = RegionIntersection(CurvesA=cir, CurvesB=rectangle.Rectangle)
extr = Extrude(Base=rint, Direction=Z)
cap = CapHoles(Brep=extr)
preview = CustomPreview(Geometry=cap, Material=ColourSwatch(SwatchColor=RGBA(242, 122, 36, 180)))

# ---- group: 01 — Spool Dimensions
number_slider_8 = Slider(5, range=5..25)
number_slider_9 = Slider(15, range=8..30)
number_slider_10 = Slider(1.8, range=1..4)
number_slider_11 = Slider(0.6, range=0.2..1.5)
division_4 = Division(A=Slider(24, range=15..45), B=2)
division_5 = Division(A=number_slider_9, B=2)
addition_3 = Addition(A=number_slider_10, B=number_slider_8)
addition_4 = Addition(A=addition_3, B=number_slider_10)

# ---- group: 07 — Calculations
pi = Pi(Factor=1)
multiplication = Multiplication(A=number_slider_4, B=number_slider_3)
division_6 = Division(A=number_slider_8, B=number_slider_4)
multiplication_2 = Multiplication(A=number_slider_9, B=pi)
multiplication_3 = Multiplication(A=multiplication, B=2)
multiplication_4 = Multiplication(A=division_6, B=multiplication_2)
panel = Panel(division_6)
panel_2 = Panel(multiplication_2)
addition_5 = Addition(A=number_slider_9, B=multiplication_3)
panel_3 = Panel(multiplication_4)
multiplication_5 = Multiplication(A=addition_5, B=pi)
panel_4 = Panel(addition_5)
panel_5 = Panel(multiplication_5)

# ---- group: 06 — Two-Hole Line Anchor
expression = Expression(x=number_slider_7, y=number_slider_5, Expression="asin((x / 2) / y) * 180 / pi")
expression_2 = Expression(x=division_5, y=number_slider_6, Expression="x * cos(y * pi / 180)")
expression_3 = Expression(x=division_5, y=number_slider_6, Expression="x * sin(y * pi / 180)")
expression_4 = Expression(x=number_slider_6, y=expression, Expression="x - y")
expression_5 = Expression(x=number_slider_6, y=expression, Expression="x + y")
expression_6 = Expression(x=number_slider_5, y=[expression_4, expression_5], Expression="x * cos(y * pi / 180)")
expression_7 = Expression(x=number_slider_5, y=[expression_4, expression_5], Expression="x * sin(y * pi / 180)")
pt = ConstructPoint(XCoordinate=expression_6, YCoordinate=expression_7, ZCoordinate=addition_3)
pt_2 = ConstructPoint(XCoordinate=expression_2, YCoordinate=expression_3, ZCoordinate=addition_3)
xy = XYPlane(Origin=pt)
pline = PolyLine(Vertices=[pt, pt_2], Closed=False)
cir_2 = Circle(Plane=xy, Radius=division_3)
Z_2 = UnitZ(Factor=number_slider_10)
extr_2 = Extrude(Base=cir_2, Direction=Z_2)
cap_2 = CapHoles(Brep=extr_2)
preview_2 = CustomPreview(Geometry=cap_2, Material=ColourSwatch(SwatchColor=RGBA(242, 208, 36, 180)))

# ---- group: 10 — Motor Flange Transition
number_slider_12 = Slider(3, range=1..6)
expression_8 = Expression(h=number_slider_12, a=Slider(45, range=30..60), Expression="h / tan(a * pi / 180)")
addition_6 = Addition(A=number_slider_10, B=number_slider_12)
addition_7 = Addition(A=division_5, B=expression_8)

# ---- group: 04 — Spool Geometry
Z_3 = UnitZ(Factor=1)
pt_3 = ConstructPoint(XCoordinate=0, YCoordinate=0, ZCoordinate=0)
pt_4 = ConstructPoint(XCoordinate=division_5, YCoordinate=0, ZCoordinate=addition_6)
pt_5 = ConstructPoint(XCoordinate=division_4, YCoordinate=0, ZCoordinate=number_slider_10)
pt_6 = ConstructPoint(XCoordinate=division_4, YCoordinate=0, ZCoordinate=addition_3)
pt_7 = ConstructPoint(XCoordinate=division_4, YCoordinate=0, ZCoordinate=0)
pt_8 = ConstructPoint(XCoordinate=division_5, YCoordinate=0, ZCoordinate=addition_3)
line = LineSDL(Start=pt_3, Direction=Z_3, Length=addition_4)
pt_9 = ConstructPoint(XCoordinate=division_4, YCoordinate=0, ZCoordinate=addition_4)
pt_10 = ConstructPoint(XCoordinate=0, YCoordinate=0, ZCoordinate=addition_4)
pt_11 = ConstructPoint(XCoordinate=addition_7, YCoordinate=0, ZCoordinate=number_slider_10)
pline_2 = PolyLine(Vertices=[pt_3, pt_7, pt_5, pt_11, pt_4, pt_8, pt_6, pt_9, pt_10], Closed=True)
expression_9 = Expression(Expression="pi / 4")
rotax = RotateAxis(Geometry=pline_2, Angle=expression_9, Axis=line)  # -> Geometry, Transform
revsrf = Revolution(Curve=rotax.Geometry, Axis=line, Domain=Domain(0, 6.283185307))
cap_3 = CapHoles(Brep=revsrf)

# ---- group: 08 — Final Solid
sdiff = SolidDifference(BrepsA=cap_3, BrepsB=cap)
sdiff_2 = SolidDifference(BrepsA=sdiff, BrepsB=cap_2)

# ---- group: 09 — Print Orientation
division_7 = Division(A=addition_4, B=2)
pt_12 = ConstructPoint(XCoordinate=0, YCoordinate=0, ZCoordinate=division_7)
xy_2 = XYPlane(Origin=pt_12)
mirror = Mirror(Geometry=sdiff_2, Plane=xy_2)  # -> Geometry, Transform

# ---- group: 08 — Final Solid (continued)
preview_3 = CustomPreview(Geometry=mirror.Geometry, Material=ColourSwatch(SwatchColor=RGB(76, 205, 217)))
